# Grasshopper definition 150122 Nest.gh (Grasshopper 0.9.14)

bottom_curve_height_sides_cm = Slider(2, range=-20..100)
height_in_middle_cm = Slider(6, range=3..40)
width_top_degrees = Slider(20, range=0..100)
amount_of_curves = Slider(20, range=0..100)
random_seed = Slider(3, range=0..10)
length_cm = Slider(10, range=0..100)
jitter_seed = Slider(2, range=0..10)
jitter = Slider(0.1, range=0..1)

# ----
# gleuf omdraaien?
# Curves verlengen naar gelang tot welke gleufrij ze horen
# ronding berekening (zie rode cirkel in defenitie)
draw_curve = BooleanToggle(False)

scale = Panel("1/10")
scale_2 = BooleanToggle(False)

milling_bit_compensation_diameter = Slider(1, range=0..10)
multiplication = Multiplication(A=height_in_middle_cm, B="10")
eval = Evaluate(F="x+(y/2)", x="90", y=width_top_degrees)
eval_2 = Evaluate(F="x-(y/2)", x="90", y=width_top_degrees)
rad = Radians(Degrees=eval_2)
rad_2 = Radians(Degrees=eval)
radius_midden = Division(A=multiplication, B="2")
dom = Domain(DomainStart=rad, DomainEnd=rad_2)
xz = XZPlane(Origin=Point(0, 0, 0))
arc = Arc(Plane=xz, Radius=radius_midden, Angle=dom)  # -> Arc, Length
division = Division(A=length_cm, B="2")
multiplication_2 = Multiplication(A=division, B="10")
end = EndPoints(Curve=arc.Arc)  # -> Start, End
pcomp = Decompose(Point=end.Start, System=PlaneXY(0, 0, 0))  # -> XComponent, YComponent, ZComponent
pcomp_2 = Decompose(Point=end.Start, System=PlaneXY(0, 0, 0))  # -> XComponent, YComponent, ZComponent
int = Integer(multiplication_2)
neg = Negative(Value=int)
pt = PointXYZ(XComponent=pcomp_2.XComponent, YComponent=neg, ZComponent=pcomp_2.ZComponent, System=PlaneXY(0, 0, 0))
pt_2 = PointXYZ(XComponent=pcomp.XComponent, YComponent=int, ZComponent=pcomp.ZComponent, System=PlaneXY(0, 0, 0))
ln = Line(StartPoint=pt_2, EndPoint=pt)
end_2 = EndPoints(Curve=arc.Arc)  # -> Start, End
vec2pt = Vector2Pt(PointA=end_2.Start, PointB=end_2.End, Unitize=False)  # -> Vector, Length
multiplication_3 = Multiplication(A=amount_of_curves, B="2")
move = Move(Geometry=ln, Motion=vec2pt.Vector)  # -> Geometry, Transform
divide = DivideCurve(Curve=ln, Count=multiplication_3, Kinks=False)  # -> flatten(Points), Tangents, Parameters
divide_2 = DivideCurve(Curve=move.Geometry, Count=multiplication_3, Kinks=False)  # -> Points, Tangents, Parameters
lng = ListLength(List=divide.Points)
subtraction = Subtraction(A=lng, B="1")
num = Number(["0", subtraction])
cull_i = CullIndex(List=divide.Points, Indices=num, Wrap=False)

# ----
# Generating points
cull = CullPattern(List=divide_2.Points, CullPattern=[False, True])
pt_3 = Point(flatten(cull_i))
pt_4 = Point(flatten(cull))
lng_2 = ListLength(List=pt_3)
lng_3 = ListLength(List=pt_4)
addition = Addition(A=lng_2, B="1")
equals = Equality(FirstNumber="0", SecondNumber=jitter)  # -> Equality, Inequality
division_2 = Division(A=addition, B=lng_3)
random = Random(Range=lng_2, Number=lng_3, Seed=random_seed)
series = Series(Start="1", Step=division_2, Count=lng_3)
cull_2 = CullPattern(List=random, CullPattern=equals.Inequality)
cull_3 = CullPattern(List=series, CullPattern=invert(equals.Inequality))
int_2 = Integer([cull_2, cull_3])

lng_4 = ListLength(List=int_2)
subtraction_2 = Subtraction(A=lng_4, B="1")
dom_2 = Domain(DomainStart="1", DomainEnd=lng_4)
range = Range(Domain=dom_2, Steps=subtraction_2)

# ----
# Filter Doubles + replace them
sort = SortList(Keys=int_2, ValuesA=range)  # -> Keys, ValuesA
shift = ShiftList(List=sort.Keys, Shift=1, Wrap=False)
lng_5 = ListLength(List=shift)
subtraction_3 = Subtraction(A=lng_5, B="1")
dcon = DeleteConsecutive(Set=shift, Wrap=False)  # -> Set, Count
item = ListItem(List=shift, Index=subtraction_3, Wrap=False)
int_3 = Integer(dcon.Set)
series_2 = Series(Start="1", Step="1", Count=item)
subtraction_4 = Subtraction(A=int_3, B="1")
cull_i_2 = CullIndex(List=series_2, Indices=subtraction_4, Wrap=False)
int_4 = Integer(cull_i_2)
int_5 = Integer(dcon.Set)
lng_6 = ListLength(List=int_4)
lng_7 = ListLength(List=shift)
lng_8 = ListLength(List=int_5)
subtraction_5 = Subtraction(A=lng_6, B="1")
subtraction_6 = Subtraction(A=lng_7, B=lng_8)
random_2 = Random(Range=subtraction_5, Number=subtraction_6, Seed=2)
int_6 = Integer(random_2)
item_2 = ListItem(List=cull_i_2, Index=int_6, Wrap=False)
weave = Weave(Pattern=[0, 1], Stream0=dcon.Set, Stream1=item_2, NullGaps=False)
sort_2 = SortList(Keys=weave)  # -> Keys, ValuesA
eval_3 = Evaluate(F="(x*2)-1", x=amount_of_curves)
lng_9 = ListLength(List=sort_2.Keys)
int_7 = Integer(eval_3)
culln = CullNth(List=sort_2.Keys, CullFrequency=lng_9)
panel = Panel(int_7)
int_8 = Integer(flatten(["1", culln, panel]))
sort_3 = SortList(Keys=int_8)  # -> Keys, ValuesA
int_9 = Integer(sort_3.Keys)
sort_4 = SortList(Keys=sort.ValuesA, ValuesA=int_9)  # -> Keys, ValuesA

slider = Slider(0.608, range=0..1)
division_3 = Division(A=slider, B="2")

# ----
# Bottom curve
# Draw curve in layer "CURVE"
pipeline = GeometryPipeline(
    LayerFilter="CURVE",
    NameFilter="*",
    TypeFilter=4,
    IncludeLocked=True,
    IncludeHidden=True,
    GroupByLayer=False,
    GroupByType=False)
crv = Curve(pipeline)
end_3 = EndPoints(Curve=crv)  # -> Start, End
pcomp_3 = Decompose(Point=end_3.Start, System=PlaneXY(0, 0, 0))  # -> XComponent, YComponent, ZComponent
pcomp_4 = Decompose(Point=end_3.End, System=PlaneXY(0, 0, 0))  # -> XComponent, YComponent, ZComponent
Y = UnitY(Factor=pcomp_3.YComponent)
Y_2 = UnitY(Factor=pcomp_4.YComponent)
X = UnitX(Factor="0")
dist = Distance(PointA=X, PointB=[Y, Y_2])
pt_5 = Point([end_3.Start, end_3.End])
sort_5 = SortList(Keys=dist, ValuesA=pt_5)  # -> Keys, ValuesA
X_2 = UnitX(Factor="0")
item_3 = ListItem(List=sort_5.ValuesA, Index=0, Wrap=False)
num_2 = Number(multiplication_2)
multiplication_4 = Multiplication(A=bottom_curve_height_sides_cm, B="10")
ln_2 = Line(StartPoint=item_3, EndPoint=X_2)
neg_2 = Negative(Value=num_2)
move_2 = Move(Geometry=crv, Motion=ln_2)  # -> Geometry, Transform
xz_2 = XZPlane(Origin=Point(0, 0, 0))
pt_6 = PointXYZ(XComponent=0, YComponent=num_2, ZComponent=multiplication_4, System=PlaneXY(0, 0, 0))
X_3 = UnitX(Factor="0")
pt_7 = PointXYZ(XComponent=0, YComponent=neg_2, ZComponent=multiplication_4, System=PlaneXY(0, 0, 0))
mirror = Mirror(Geometry=move_2.Geometry, Plane=xz_2)  # -> Geometry, Transform
arc_2 = Arc3Pt(PointA=pt_6, PointB=X_3, PointC=pt_7)  # -> Arc, Plane, Radius
join = JoinCurves(Curves=[move_2.Geometry, mirror.Geometry], Preserve=False)
cull_4 = CullPattern(List=arc_2.Arc, CullPattern=invert(draw_curve))
cull_5 = CullPattern(List=join, CullPattern=draw_curve)
bottom_curve = Curve(flatten([cull_4, cull_5]))

int_10 = Integer(sort_4.ValuesA)
pshift = ShiftPaths(Data=int_10, Offset=-1)
subtraction_7 = Subtraction(A=pshift, B="1")
pt_8 = Point(flatten(cull_i))
item_4 = ListItem(List=pt_8, Index=subtraction_7, Wrap=False)
sort_6 = SortList(Keys=sort_4.ValuesA, ValuesA=item_4)  # -> Keys, ValuesA
jitter_2 = Jitter(List=sort_6.ValuesA, Jitter=jitter, Seed=jitter_seed)  # -> Values, Indices
int_11 = Integer(sort_6.Keys)
flatten = FlattenTree(Data=jitter_2.Values, Path="{0}")
pt_9 = Point(flatten(cull))
jitter_3 = Jitter(List=int_11, Jitter=jitter, Seed=jitter_seed)  # -> flatten(Values), Indices
pt_10 = Point(flatten)
ln_3 = Line(StartPoint=pt_10, EndPoint=pt_9)
eval_4 = EvaluateLength(Curve=ln_3, Length="0.5", Normalized=True)  # -> Point, Tangent, Parameter
neg_3 = Negative(Value=radius_midden)
Z = UnitZ(Factor=neg_3)
move_3 = Move(Geometry=eval_4.Point, Motion=Z)  # -> Geometry, Transform
ln_4 = Line(StartPoint=eval_4.Point, EndPoint=move_3.Geometry)
clx = CurveLine(Curve=bottom_curve, Line=ln_4)  # -> flatten(Points), Params, Count
pt_11 = Point(clx.Points)
pcomp_5 = Decompose(Point=pt_11, System=PlaneXY(0, 0, 0))  # -> XComponent, YComponent, ZComponent
yz = YZPlane(Origin=Point(0, 0, 0))
arc_3 = CircularArc(arc.Arc)
mirror_2 = Mirror(Geometry=arc.Arc, Plane=yz)  # -> Geometry, Transform
pt_12 = PointXYZ(XComponent="2", YComponent=pcomp_5.YComponent, ZComponent=pcomp_5.ZComponent, System=PlaneXY(0, 0, 0))
eval_5 = EvaluateCurve(Curve=arc_3, Parameter="0")  # -> Point, Tangent, Angle
eval_6 = EvaluateCurve(Curve=mirror_2.Geometry, Parameter="0")  # -> Point, Tangent, Angle
rev = Reverse(Vector=eval_5.Tangent)
vec2pt_2 = Vector2Pt(PointA=pt_12, PointB=pt_11, Unitize=False)  # -> Vector, Length
vec = Vector(eval_6.Tangent)
vec_2 = Vector(rev)
vec_3 = Vector(vec2pt_2.Vector)
neg_4 = Negative(Value=vec)
neg_5 = Negative(Value=vec_3)
biarc = BiArc(StartPoint=pt_10, StartTangent=vec_2, EndPoint=pt_11, EndTangent=vec_3, Ratio=Slider(0.45, range=0..1))  # -> FirstArc, SecondArc, BiArc
biarc_2 = BiArc(StartPoint=pt_9, StartTangent=neg_4, EndPoint=pt_11, EndTangent=neg_5, Ratio=Slider(0.2, range=0..1))  # -> FirstArc, SecondArc, BiArc
flip = Flip(Curve=biarc.BiArc)  # -> Curve, Flag
graft = GraftTree(Data=biarc_2.BiArc, IncludeNullItems=True, IncludeEmptyLists=True)
graft_2 = GraftTree(Data=flip.Curve, IncludeNullItems=True, IncludeEmptyLists=True)
geo = Geometry([graft_2, graft])
join_2 = JoinCurves(Curves=geo, Preserve=False)

# ----
# General shape + lines
len = Length(Curve=join_2)
flatten_2 = FlattenTree(Data=len, Path="{0}")
num_3 = Number(flatten_2)
top_arc_length = Number(arc.Length)
num_4 = Number(amount_of_curves)
line = Line(ln)
len_2 = Length(Curve=line)
division_4 = Division(A=len_2, B=num_4)
addition_2 = Addition(A=num_4, B="1")
series_3 = Series(Start=0, Step=division_4, Count=addition_2)
lng_10 = ListLength(List=series_3)
addition_3 = Addition(A=num_4, B="1")
addition_4 = Addition(A=top_arc_length, B=num_3)
series_4 = Series(Start=division_4, Step=division_4, Count=num_4)
pt_13 = PointXYZ(XComponent=top_arc_length, YComponent=len_2, ZComponent=0, System=PlaneXY(0, 0, 0))
culln_2 = CullNth(List=series_3, CullFrequency=lng_10)
series_5 = Series(Start=0, Step=division_4, Count=addition_3)
pt_14 = PointXYZ(XComponent=top_arc_length, YComponent=culln_2, ZComponent=0, System=PlaneXY(0, 0, 0))
pt_15 = PointXYZ(XComponent=addition_4, YComponent=series_4, ZComponent=0, System=PlaneXY(0, 0, 0))
rec_2pt = Rectangle2Pt(Plane=PlaneXY(0, 0, 0), PointA=Point(0, 0, 0), PointB=pt_13, Radius=0)  # -> Rectangle, Length
pt_16 = PointXYZ(XComponent=top_arc_length, YComponent=series_5, ZComponent=0, System=PlaneXY(0, 0, 0))
pt_17 = Point(pt_14)
pt_18 = Point(pt_15)
shift_2 = ShiftList(List=pt_16, Shift=1, Wrap=False)
rec_2pt_2 = Rectangle2Pt(Plane=PlaneXY(0, 0, 0), PointA=pt_17, PointB=pt_18, Radius=0)  # -> flatten(Rectangle), Length
ln_5 = Line(StartPoint=shift_2, EndPoint=pt_18)
runion = RegionUnion(Curves=[rec_2pt.Rectangle, rec_2pt_2.Rectangle])  # -> flatten(Result)

thickness_material = Slider(0.3, range=0..1)
list = ValueList({"CNC CURVES": 1, "LASERCUT": 2, "TURN OFF CURVES": 3}, selected=[], ListIndex=0, UIMode=1)
preview = BooleanToggle(True)
width_curves = Panel(division_4)

subtraction_8 = Subtraction(A=width_curves, B=milling_bit_compensation_diameter)

# ----
# CONNECTOR select + scale to size
connector_detection = GeometryPipeline(
    LayerFilter="CONNECTOR",
    NameFilter="*",
    TypeFilter=4,
    IncludeLocked=True,
    IncludeHidden=True,
    GroupByLayer=False,
    GroupByType=False)
geo_2 = Geometry(connector_detection)
area = Area(Geometry=geo_2)  # -> Area, Centroid
bbox = BoundingBox(Content=geo_2, Plane=PlaneXY(0, 0, 0))  # -> Box, Box_2
num_5 = Number(subtraction_8)
box = BoxComponents(Box=bbox.Box)  # -> Plane, X, Y, Z
max_width_slot = Panel(num_5)
num_6 = Number(box.Y)
division_5 = Division(A=max_width_slot, B=num_6)
scale_3 = Scale(Geometry=geo_2, Center=area.Centroid, Factor=division_5)  # -> Geometry, Transform
geo_3 = Geometry(scale_3.Geometry)

# ----
# SLOT select + scale to size
slot_detection = GeometryPipeline(
    LayerFilter="SLOT",
    NameFilter="*",
    TypeFilter=4,
    IncludeLocked=True,
    IncludeHidden=True,
    GroupByLayer=False,
    GroupByType=False)
set_slot_from_rhino = Geometry(slot_detection)
area_2 = Area(Geometry=set_slot_from_rhino)  # -> Area, Centroid
bbox_2 = BoundingBox(Content=set_slot_from_rhino, Plane=PlaneXY(0, 0, 0))  # -> Box, Box_2
num_7 = Number(subtraction_8)
box_2 = BoxComponents(Box=bbox_2.Box)  # -> Plane, X, Y, Z
max_width_slot_2 = Panel(num_7)
num_8 = Number(box_2.Y)
division_6 = Division(A=max_width_slot_2, B=num_8)
scale_4 = Scale(Geometry=set_slot_from_rhino, Center=area_2.Centroid, Factor=division_6)  # -> Geometry, Transform
geo_4 = Geometry(scale_4.Geometry)

# ----
# Placement Slots
distance_from_first_row = Slider(4, range=0..100)
distance_to_first_row = Slider(1, range=0..100)
multiplication_5 = Multiplication(A=length_cm, B="10")
pt_19 = PointXYZ(XComponent=distance_to_first_row, YComponent=multiplication_5, ZComponent=0, System=PlaneXY(0, 0, 0))
X_4 = UnitX(Factor=distance_to_first_row)
ln_6 = Line(StartPoint=X_4, EndPoint=pt_19)
int_12 = Integer(sort_4.ValuesA)
int_13 = Integer(multiplication_3)
pshift_2 = ShiftPaths(Data=int_12, Offset=-1)
divide_3 = DivideCurve(Curve=ln_6, Count=int_13, Kinks=False)  # -> Points, Tangents, Parameters
subtraction_9 = Subtraction(A=pshift_2, B="1")
lng_11 = ListLength(List=divide_3.Points)
sort_7 = SortList(Keys=subtraction_9)  # -> Keys, ValuesA
subtraction_10 = Subtraction(A=lng_11, B="1")
bbox_3 = BoundingBox(Content=geo_4, Plane=PlaneXY(0, 0, 0))  # -> Box, Box_2
rev_2 = ReverseList(List=sort_7.Keys)
num_9 = Number(flatten(["0", subtraction_10]))
item_5 = ListItem(List=rev_2, Index=0, Wrap=False)
box_3 = BoxComponents(Box=bbox_3.Box)  # -> Plane, X, Y, Z
cull_i_3 = CullIndex(List=divide_3.Points, Indices=num_9, Wrap=False)
X_5 = UnitX(Factor=distance_from_first_row)
addition_5 = Addition(A=item_5, B="1")
domcomp = DomainComponents(Domain=box_3.Y)  # -> Start, End
domcomp_2 = DomainComponents(Domain=box_3.X)  # -> Start, End
num_10 = Number(box_3.Y)
move_4 = Move(Geometry=cull_i_3, Motion=X_5)  # -> Geometry, Transform
division_7 = Division(A=num_10, B="2")
division_8 = Division(A=addition_5, B="1")
cull_6 = CullPattern(List=move_4.Geometry, CullPattern=[False, True])
cull_7 = CullPattern(List=cull_i_3, CullPattern=[True, False])
series_6 = Series(Start="0", Step="1", Count=division_8)
addition_6 = Addition(A=division_7, B=domcomp.Start)
weave_2 = Weave(Pattern=[0, 1], Stream0=cull_7, Stream1=cull_6, NullGaps=False)
pt_20 = PointXYZ(XComponent=domcomp_2.Start, YComponent=addition_6, ZComponent=0, System=PlaneXY(0, 0, 0))
cull_i_4 = CullIndex(List=series_6, Indices=subtraction_9, Wrap=False)
cull_i_5 = CullIndex(List=weave_2, Indices=cull_i_4, Wrap=False)
pt_21 = Point(cull_i_5)
ln_7 = Line(StartPoint=pt_20, EndPoint=pt_21)
move_5 = Move(Geometry=geo_4, Motion=ln_7)  # -> Geometry, Transform

# ----
# Placement Connector
bbox_4 = BoundingBox(Content=geo_3, Plane=PlaneXY(0, 0, 0))  # -> Box, Box_2
box_4 = BoxComponents(Box=bbox_4.Box)  # -> Plane, X, Y, Z
domcomp_3 = DomainComponents(Domain=box_4.X)  # -> Start, End
domcomp_4 = DomainComponents(Domain=box_4.Y)  # -> Start, End
num_11 = Number(box_4.Y)
division_9 = Division(A=num_11, B="2")
addition_7 = Addition(A=division_9, B=domcomp_4.Start)
pt_22 = PointXYZ(XComponent=domcomp_3.Start, YComponent=domcomp_4.End, ZComponent=0, System=PlaneXY(0, 0, 0))  # -> flatten(Point)
pt_23 = Point(pt_22)
pt_24 = Point(pt_18)
division_10 = Division(A=milling_bit_compensation_diameter, B="2")
ln_8 = Line(StartPoint=pt_23, EndPoint=pt_24)
neg_6 = Negative(Value=division_10)
move_6 = Move(Geometry=geo_3, Motion=ln_8)  # -> Geometry, Transform
Y_3 = UnitY(Factor=neg_6)
move_7 = Move(Geometry=move_6.Geometry, Motion=Y_3)  # -> flatten(Geometry), Transform

# ----
# CNC
line_2 = Line(ln_5)
geo_5 = Geometry(move_5.Geometry)
geo_6 = Geometry(runion)
pt_25 = Point(shift_2)
geo_7 = Geometry(move_7.Geometry)
shift_3 = ShiftList(List=line_2, Shift=1, Wrap=False)
len_3 = Length(Curve=shift_3)
len_4 = Length(Curve=line_2)
runion_2 = RegionUnion(Curves=[geo_7, geo_6])
max = Maximum(A=len_3, B=len_4)
X_6 = UnitX(Factor=1)
line_3 = LineSDL(Start=pt_25, Direction=X_6, Length=max)
lng_12 = ListLength(List=line_3)
culln_3 = CullNth(List=line_3, CullFrequency=lng_12)
geo_8 = Geometry(flatten([geo_5, culln_3]))
geo_9 = Geometry(runion_2)
cull_8 = CullPattern(List=[geo_8, geo_9], CullPattern=scale_2)  # -> flatten(List)
equals_2 = Equality(FirstNumber=list, SecondNumber="1")  # -> Equality, Inequality
scale_5 = Scale(Geometry=cull_8, Center=Point(0, 0, 0), Factor=scale)  # -> Geometry, Transform
cull_9 = CullPattern(List=geo_8, CullPattern=equals_2.Equality)  # -> flatten(List)
cull_10 = CullPattern(List=geo_9, CullPattern=equals_2.Equality)  # -> flatten(List)
preview_2 = CustomPreview(Geometry=[cull_10, cull_9], Shader=ColourSwatch(SwatchColor=RGB(0, 255, 51)))

# ----
# Outer dimensions
bbox_5 = BoundingBox(Content=geo_9, Plane=PlaneXY(0, 0, 0))  # -> flatten(Box), Box_2
xy = XYPlane(Origin=Point(0, 0, 0))
project = Project(Geometry=bbox_5.Box, Plane=xy)  # -> Geometry, Transform
lenseg = SegmentLengths(Curve=project.Geometry)  # -> ShortestLength, ShortestDomain, LongestLength, LongestDomain
division_11 = Division(A=lenseg.LongestLength, B="2")
division_12 = Division(A=lenseg.ShortestLength, B="2")
round = Round(Number=[lenseg.ShortestLength, lenseg.LongestLength])  # -> Nearest, Floor, Ceiling
sort_8 = SortList(Keys=round.Ceiling)  # -> Keys, ValuesA
shift_4 = ShiftList(List=sort_8.Keys, Shift=1, Wrap=False)
division_13 = Division(A=shift_4, B="10")  # -> flatten(Result)
division_14 = Division(A=shift_4, B="20")  # -> flatten(Result)
addition_8 = Addition(A=division_14, B=lenseg.LongestLength)
addition_9 = Addition(A=division_13, B=lenseg.ShortestLength)
pt_26 = PointXYZ(XComponent=addition_8, YComponent=division_12, ZComponent=0, System=PlaneXY(0, 0, 0))
pt_27 = PointXYZ(XComponent=division_11, YComponent=addition_9, ZComponent=0, System=PlaneXY(0, 0, 0))
pt_28 = Point(pt_27)
pt_29 = Point(pt_26)
division_15 = Division(A=shift_4, B="15")
xy_2 = XYPlane(Origin=[pt_29, pt_28])
equals_3 = Equality(FirstNumber=list, SecondNumber="1")  # -> Equality, Inequality
cull_11 = CullPattern(List=round.Ceiling, CullPattern=equals_3.Equality)  # -> flatten(List)
tag = TextTag3D(Location=xy_2, Text=cull_11, Size=division_15)

# ----
# Lasercut
pt_30 = Point(shift_2)
geo_10 = Geometry(move_5.Geometry)
geo_11 = Geometry(runion)
geo_12 = Geometry(move_7.Geometry)
line_4 = Line(ln_5)
shift_5 = ShiftList(List=line_4, Shift=1, Wrap=False)
len_5 = Length(Curve=shift_5)
len_6 = Length(Curve=line_4)
min = Minimum(A=len_5, B=len_6)
X_7 = UnitX(Factor=1)
line_5 = LineSDL(Start=pt_30, Direction=X_7, Length=min)
graft_3 = GraftTree(Data=geo_11, IncludeNullItems=True, IncludeEmptyLists=True)
lng_13 = ListLength(List=line_5)
runion_3 = RegionUnion(Curves=[geo_12, graft_3])
culln_4 = CullNth(List=line_5, CullFrequency=lng_13)
geo_13 = Geometry(flatten([geo_10, culln_4]))
geo_14 = Geometry(runion_3)
equals_4 = Equality(FirstNumber=list, SecondNumber="2")  # -> Equality, Inequality
cull_12 = CullPattern(List=geo_13, CullPattern=equals_4.Equality)  # -> flatten(List)
cull_13 = CullPattern(List=geo_14, CullPattern=equals_4.Equality)  # -> flatten(List)
preview_3 = CustomPreview(Geometry=[cull_12, cull_13], Shader=ColourSwatch(SwatchColor=RGB(255, 0, 0)))

area_3 = Area(Geometry=move_7.Geometry)  # -> Area, Centroid
pcomp_6 = Decompose(Point=area_3.Centroid, System=PlaneXY(0, 0, 0))  # -> XComponent, YComponent, ZComponent
pcomp_7 = Decompose(Point=pt_21, System=PlaneXY(0, 0, 0))  # -> XComponent, YComponent, ZComponent
subtraction_11 = Subtraction(A=pcomp_6.YComponent, B=division_3)
subtraction_12 = Subtraction(A=pcomp_7.XComponent, B=Slider(1, range=0..1))
subtraction_13 = Subtraction(A=pcomp_7.YComponent, B=division_3)
pt_31 = PointXYZ(XComponent=pcomp_6.XComponent, YComponent=subtraction_11, ZComponent=pcomp_6.ZComponent, System=PlaneXY(0, 0, 0))
pt_32 = PointXYZ(XComponent=subtraction_12, YComponent=subtraction_13, ZComponent=pcomp_7.ZComponent, System=PlaneXY(0, 0, 0))
lng_14 = ListLength(List=move_7.Geometry)
series_7 = Series(Start="1", Step=1, Count=lng_14)
int_14 = Integer(series_7)
sort_9 = SortList(Keys=jitter_3.Values, ValuesA=int_14)  # -> Keys, ValuesA
int_15 = Integer(sort_9.ValuesA)
tag_2 = TextTag3D(Location=pt_31, Text=int_14, Size=slider)
tag_3 = TextTag3D(Location=pt_32, Text=int_15, Size=slider)
line_6 = Line(ln)

# ----
# 3D
flatten_3 = FlattenTree(Data=join_2, Path="{0}")
end_4 = EndPoints(Curve=flatten_3)  # -> Start, End
division_16 = Division(A=multiplication_2, B=amount_of_curves)
pcomp_8 = Decompose(Point=end_4.End, System=PlaneXY(0, 0, 0))  # -> XComponent, YComponent, ZComponent
pcomp_9 = Decompose(Point=end_4.End, System=PlaneXY(0, 0, 0))  # -> XComponent, YComponent, ZComponent
num_12 = Number(division_16)
addition_10 = Addition(A=pcomp_8.YComponent, B=num_12)
subtraction_14 = Subtraction(A=pcomp_9.YComponent, B=num_12)
pt_33 = PointXYZ(XComponent=pcomp_9.XComponent, YComponent=subtraction_14, ZComponent=pcomp_9.ZComponent, System=PlaneXY(0, 0, 0))
pt_34 = PointXYZ(XComponent=pcomp_8.XComponent, YComponent=addition_10, ZComponent=pcomp_8.ZComponent, System=PlaneXY(0, 0, 0))
subtraction_15 = Subtraction(A=radius_midden, B="1")
ln_9 = Line(StartPoint=pt_34, EndPoint=pt_33)
arc_4 = CircularArc(arc.Arc)
swp1 = Sweep1(Rail=arc_4, Sections=line_6, Miter=1)
pt_35 = PointXYZ(XComponent=0, YComponent="2", ZComponent=subtraction_15, System=PlaneXY(0, 0, 0))
Z_2 = UnitZ(Factor=subtraction_15)
offset = Offset(Surface=swp1, Distance=thickness_material, Retrim=True)
ln_10 = Line(StartPoint=Z_2, EndPoint=pt_35)
loft = Loft(Curves=[offset, swp1], Options={Adjust=False, Closed=False, Rebuild=10, Refit=0.01, LoftType=0, LoftEnds=0, LoftSimp=0})
railrev = RailRevolution(Curve=flatten_3, Rail=ln_9, Axis=ln_10, Scale=False)
geo_15 = Geometry([loft, offset, swp1])
neg_7 = Negative(Value=thickness_material)
offset_2 = Offset(Surface=railrev, Distance=neg_7, Retrim=True)
graft_4 = GraftTree(Data=railrev, IncludeNullItems=True, IncludeEmptyLists=True)
graft_5 = GraftTree(Data=offset_2, IncludeNullItems=True, IncludeEmptyLists=True)
loft_2 = Loft(
    Curves=[graft_5, graft_4],
    Options={Adjust=False, Closed=False, Rebuild=10, Refit=0.01, LoftType=0, LoftEnds=0, LoftSimp=0})  # -> flatten(Loft)

geo_16 = Geometry(geo_15)

geo_17 = Geometry([loft_2, offset_2, railrev, geo_16])

# ----
# Move & rotate
flatten_4 = FlattenTree(Data=geo_17, Path="{0}")
group = Group(Objects=flatten_4)
bbox_6 = BoundingBox(Content=group, Plane=PlaneXY(0, 0, 0))  # -> Box, Box_2
box_5 = BoxComponents(Box=bbox_6.Box)  # -> Plane, X, Y, Z
num_13 = Number(box_5.X)
num_14 = Number(box_5.Y)
num_15 = Number(box_5.Z)
neg_8 = Negative(Value=num_13)
division_17 = Division(A=num_15, B="2")
division_18 = Division(A=num_14, B="2")
area_4 = Area(Geometry=bbox_6.Box)  # -> Area, Centroid
pt_36 = PointXYZ(XComponent=neg_8, YComponent=division_18, ZComponent=division_17, System=PlaneXY(0, 0, 0))
ln_11 = Line(StartPoint=area_4.Centroid, EndPoint=pt_36)
move_8 = Move(Geometry=geo_17, Motion=ln_11)  # -> Geometry, Transform
flatten_5 = FlattenTree(Data=move_8.Geometry, Path="{0}")
group_2 = Group(Objects=flatten_5)
bbox_7 = BoundingBox(Content=group_2, Plane=PlaneXY(0, 0, 0))  # -> Box, Box_2
area_5 = Area(Geometry=bbox_7.Box)  # -> Area, Centroid
pcomp_10 = Decompose(Point=area_5.Centroid, System=PlaneXY(0, 0, 0))  # -> XComponent, YComponent, ZComponent
addition_11 = Addition(A=pcomp_10.ZComponent, B="1")
pt_37 = PointXYZ(XComponent=pcomp_10.XComponent, YComponent=pcomp_10.YComponent, ZComponent=addition_11, System=PlaneXY(0, 0, 0))
rad_3 = Radians(Degrees="180")
ln_12 = Line(StartPoint=area_5.Centroid, EndPoint=pt_37)
rotate = Rotate(Geometry=move_8.Geometry, Angle=rad_3, Plane=ln_12)  # -> Geometry, Transform

# ----
# Preview 3D
cull_14 = CullPattern(List=rotate.Geometry, CullPattern=preview)
preview_4 = CustomPreview(Geometry=cull_14, Shader=ColourSwatch(SwatchColor=RGB(219, 219, 219)))
